# Grasshopper definition soundwave.gh (Grasshopper 1.0.6)
# plug-ins: MosquitoAudio2

path = FilePath("D:\Users\ewitt4\Documents\GitHub\ewitt4-poetry-repository\markovified-poem14.mp3")
audiowave = AudioWave(AudioFile=path, XOffset=Slider(0.25, range=0..1), Skip=Slider(2000, range=0..5000))  # -> Peak, Points, Length
play = AudioPlay(AudioFile=path, Boolean=Toggle(True))
intcrv = Interpolate(Vertices=audiowave.Points, Degree=3, Periodic=False, KnotStyle=1)  # -> Curve, Length, Domain
